# Grasshopper definition Parametrics_FA21_ArPrivacyScreensDemo_20211115_boxMorph.gh (Grasshopper 1.0.7)
# plug-ins: ShapeDiverForGrasshopper, GrasshopperHyperGooComponents, BitmapComponent, Pufferfish, Weaverbird, Kangaroo2 Components

sddb = ShapeDiverDatabase({AbsoluteTolerance=0.001, AngleTolerance=1, AppDescription="", AppName="Parametrics_FA21_ArPrivacyScreensDemo_20211025*", DocumentName="Parametrics_FA21_ArPrivacyScreensDemo_20211025*", InputGroups="{\"164aa572-da35-488a-80ec-ed14e7c85878\":{\"name\":\"SDInput\",\"guid\":\"164aa572-da35-488a-80ec-ed14e7c85878\",\"index\":0,\"params\":[\"ea71f66d-149a-461a-9965-242fac1f9d5f\"],\"indexFloor\":0,\"indexCeiling\":0}}", OutputGroups="{}", RelativeTolerance=0.01, UnitSystem=4})
crv = Curve([<curve referenced from the Rhino model> x3])
loft = Loft(Curves=crv, Options={Adjust=False, Closed=False, LoftEnds=0, LoftSimp=0, LoftType=0, Rebuild=10, Refit=0.01})
triremesh = TriRemesh(Geometry=loft, Length=Slider(0.409, range=0..1), Iterations=25)  # -> Triangulation, Dual, Creases
m_snubsqr = SnubSquareTiling(S=loft, U=Slider(10, range=5..25), V=Slider(13, range=5..25), T=Slider(0.592, range=0..1), Q=True, C=False)  # -> out, M; inputs S: Surface
#   port out: A list of corresponding faces describing the selected pattern.
# ---------- m_snubsqr: VB ----------
    Component.Params.Input(0).Name = "Surface"
    Component.Params.Input(0).Description = "The base surface to mesh"
    Component.Params.Input(1).Name = "Polygon Types"
    Component.Params.Input(1).Description = "0=All, 1=Regular Only, 2=Infill Only"
    Component.Params.Input(2).Name = "U Count"
    Component.Params.Input(2).Description = "The number of quads in the U direction"
    Component.Params.Input(3).Name = "V Count"
    Component.Params.Input(3).Description = "The number of quads in the V direction"
    Component.Params.Input(4).Name = "Flip"
    Component.Params.Input(4).Description = "Flips the pattern sequence"
    Component.Params.Input(5).Name = "Evaluate"
    Component.Params.Input(5).Description = "A unitized value which symmetrically shifts the location of internal vertices within each new quad"
    Component.Params.Input(6).Name = "Quad"
    Component.Params.Input(6).Description = "If true, all faces will be quads else a mix of quads and triangles"
    Component.Params.Input(7).Name = "Close Edges"
    Component.Params.Input(7).Description = "If true, additional faces will be added, matching the original surface edge"

    Component.Params.Output(1).Name = "Mesh"
    Component.Params.Output(1).Description = "If successful, the resulting mesh"

    If s IsNot Nothing Then
      Dim i,j,k,x,y As Integer
      Dim wu,wv As New list(Of Integer)
      Dim bu, bv As Boolean
      Dim cu, cv,au,av As Integer
      Dim arrPts As New list(Of point3d)
      Dim arrFaces As New list(Of MeshFace)
      Dim mo As New mesh
      Dim mv As New list(Of point3d)
      Dim mf As New list(Of meshface)
      Dim uva(,) As Integer
      Dim uvb(,) As Integer

      u += 1
      v += 1

      bu = s.IsClosed(0)
      bv = s.IsClosed(1)

      S.SetDomain(0, New interval(0, 1))
      S.SetDomain(1, New interval(0, 1))

      If (bu And (u Mod 2)) Then
        wu = appendprepend(U)
        cu = u
        au = 1
      Else
        wu = series(U)
        cu = u
        au = 0
      End If

      If (bv And (v Mod 2)) Then
        wv = appendprepend(V)
        cv = v
        av = 1
      Else
        wv = series(V)
        cV = v
        av = 0
      End If

      ReDim uva(cu - 1, cv - 1)
      ReDim uvb(cu - 1, cv - 1)

      If f Then y = 1 Else y = 0

      For i = 0 To cu - 1 - au Step 1
        For j = 0 To cv - 2 Step 1
          Dim pt(1) As point3d

          pt(0) = S.PointAt(i * (1 / (U - 1)), j * (1 / (V - 1)))
          pt(1) = S.PointAt(i * (1 / (U - 1)), (j + 1) * (1 / (V - 1)))

          mv.add(evalP(pt((i + j) Mod 2), pt((i + j + 1) Mod 2), t))
          uva(i, j) = x
          x += 1
        Next
      Next
      k = mv.count()

      x = 0
      For i = 0 To cu - 2 Step 1
        For j = 0 To cv - 1 - av  Step 1
          Dim pt(1) As point3d

          pt(1) = S.PointAt(i * (1 / (U - 1)), j * (1 / (V - 1)))
          pt(0) = S.PointAt((i + 1) * (1 / (U - 1)), j * (1 / (V - 1)))

          mv.add(evalP(pt((i + j) Mod 2), pt((i + j + 1) Mod 2), t))
          uvb(i, j) = k + x
          x += 1
        Next
      Next

      If O <> 2 Then
        For i = 0 To U - 2 Step 1
          For j = 0 To V - 2 Step 1
            mf.add(New meshface(uvb(wu(i), wv(j + 1)), uva(wu(i), wv(j)), uvb(wu(i), wv(j)), uva(wu(i + 1), wv(j))))
          Next
        Next
      End If
      If O <> 1 Then
        If Q Then
          For i = 1 To U - 2 Step 1
            For j = 1 To V - 2 Step 1
              mf.add(New meshface(uvb(wu(i - 1), wv(j)), uva(wu(i), wv(j - 1)), uvb(wu(i), wv(j)), uva(wu(i), wv(j))))
            Next
          Next
        Else
          For i = 1 To U - 2 Step 1
            For j = 1 To V - 2 Step 1
              Dim tf(3) As meshface
              tf(0) = New meshface(uva(wu(i), wv(j - 1)), uvb(wu(i), wv(j)), uva(wu(i), wv(j)))
              tf(2) = New meshface(uva(wu(i), wv(j - 1)), uva(wu(i), wv(j)), uvb(wu(i - 1), wv(j)))

              tf(1) = New meshface(uvb(wu(i - 1), wv(j)), uvb(wu(i), wv(j)), uva(wu(i), wv(j)))
              tf(3) = New meshface(uva(wu(i), wv(j - 1)), uvb(wu(i), wv(j)), uvb(wu(i - 1), wv(j)))

              mf.add(tf(0 + ((i + j + f) Mod 2)))
              mf.add(tf(2 + ((i + j + f) Mod 2)))
            Next
          Next
        End If
      End If

      k = mv.count()

      If c Then

        If q Then ' Close Options for Quads
          For i = 1 To U - 2 Step 1
            If (bv And (v Mod 2)) Then
              mf.add(New meshface(uvb(wu(i - 1), wv(v - 1)), uva(wu(i), wv(v - 2)), uvb(wu(i), wv(v - 1)), uva(wu(i), wv(0))))
            Else
              mf.add(New meshface(uvb(wu(i), wv(0)), uva(wu(i), wv(0)), uvb(wu(i - 1), wv(0))))
              mf.add(New meshface(uvb(wu(i - 1), wv(v - 1)), uva(wu(i), wv(v - 2)), uvb(wu(i), wv(v - 1))))
            End If
          Next

          For j = 1 To V - 2 Step 1
            If (bu And (u Mod 2)) Then
              mf.add(New meshface(uva(wu(0), wv(j - 1)), uvb(wu(0), wv(j)), uva(wu(0), wv(j)), uvb(wu(u - 2), wv(j))))
            Else
              mf.add(New meshface(uva(wu(0), wv(j - 1)), uvb(wu(0), wv(j)), uva(wu(0), wv(j))))
              mf.add(New meshface(uva(wu(u - 1), wv(j)), uvb(wu(u - 2), wv(j)), uva(wu(u - 1), wv(j - 1))))
            End If
          Next

        Else' Close Options for Triangles

          For j = 1 To V - 2 Step 1

            If (bu And (u Mod 2)) Then
              If (j + y) Mod 2 Then
                mf.add(New meshface(uvb(wu(u - 2), wv(j)), uva(wu(0), wv(j - 1)), uvb(wu(0), wv(j))))
                mf.add(New meshface(uvb(wu(0), wv(j)), uva(wu(0), wv(j)), uvb(wu(u - 2), wv(j))))
              Else
                mf.add(New meshface(uva(wu(0), wv(j)), uva(wu(0), wv(j - 1)), uvb(wu(0), wv(j))))
                mf.add(New meshface(uva(wu(0), wv(j - 1)), uva(wu(0), wv(j)), uvb(wu(u - 2), wv(j))))
              End If
            Else
              If (j + y) Mod 2 Then
                mv.add(S.PointAt(0, j * (1 / (v - 1))))
                mf.add(New meshface(uva(wu(0), wv(j - 1)), uvb(wu(0), wv(j)), k))
                mf.add(New meshface(k, uvb(wu(0), wv(j)), uva(wu(0), wv(j))))
                k += 1
              Else
                mf.add(New meshface(uva(wu(0), wv(j - 1)), uvb(wu(0), wv(j)), uva(wu(0), wv(j))))
              End If

              If (j + y + ((u + 1) Mod 2)) Mod 2 Then
                mv.add(S.PointAt(1, j * (1 / (v - 1))))
                mf.add(New meshface(uvb(wu(u - 2), wv(j)), uva(wu(u - 1), wv(j - 1)), k))
                mf.add(New meshface(k, uva(wu(u - 1), wv(j)), uvb(wu(u - 2), wv(j))))
                k += 1
              Else
                mf.add(New meshface(uva(wu(u - 1), wv(j)), uvb(wu(u - 2), wv(j)), uva(wu(u - 1), wv(j - 1))))
              End If

            End If
          Next

          For i = 1 To u - 2 Step 1

            If (bv And (v Mod 2)) Then
              If (i + y) Mod 2 Then
                mf.add(New meshface(uva(wu(i), wv(v - 2)), uva(wu(i), wv(0)), uvb(wu(i - 1), wv(0))))
                mf.add(New meshface(uva(wu(i), wv(0)), uva(wu(i), wv(v - 2)), uvb(wu(i), wv(0))))
              Else
                mf.add(New meshface(uvb(wu(i), wv(0)), uva(wu(i), wv(0)), uvb(wu(i - 1), wv(0))))
                mf.add(New meshface(uvb(wu(i - 1), wv(0)), uva(wu(i), wv(v - 2)), uvb(wu(i), wv(0))))
              End If
            Else
              If (i + y + 1) Mod 2 Then
                mv.add(S.PointAt(i * (1 / (u - 1)), 0))
                mf.add(New meshface(uva(wu(i), wv(0)), uvb(wu(i - 1), wv(0)), k))
                mf.add(New meshface(k, uvb(wu(i), wv(0)), uva(wu(i), wv(0))))
                k += 1
              Else
                mf.add(New meshface(uvb(wu(i - 1), wv(0)), uvb(wu(i), wv(0)), uva(wu(i), wv(0))))
              End If

              If (i + y + 1 + ((v + 1) Mod 2)) Mod 2 Then
                mv.add(S.PointAt(i * (1 / (u - 1)), 1))
                mf.add(New meshface(uvb(wu(i - 1), wv(v - 1)), uva(wu(i), wv(v - 2)), k))
                mf.add(New meshface(k, uva(wu(i), wv(v - 2)), uvb(wu(i), wv(v - 1))))
                k += 1
              Else
                mf.add(New meshface(uvb(wu(i), wv(v - 1)), uvb(wu(i - 1), wv(v - 1)), uva(wu(i), wv(v - 2))))
              End If

            End If
          Next

        End If
        If (bu And bv) Then 'If closed in both U and V

          If (q And (u Mod 2) And (v Mod 2))Then
            mf.add(New meshface(uva(wu(0), wv(0)), uvb(wu(u - 2), wv(v - 1)), uva(wu(0), wv(v - 2)), uvb(wu(0), wv(v - 1))))
          ElseIf ((u Mod 2) And (v Mod 2) And f) Then
            mf.add(New meshface(uva(wu(0), wv(0)), uvb(wu(u - 2), wv(v - 1)), uva(wu(0), wv(v - 2)), uvb(wu(0), wv(v - 1))))
          Else
            mv.add(s.PointAt(0, 0))
            mf.add(New meshface(uva(wu(0), wv(0)), k, uvb(wu(0), wv(0))))
            mf.add(New meshface(uva(wu(u - 1), wv(0)), uvb(wu(u - 2), wv(0)), k))
            mf.add(New meshface(uva(wu(0), wv(v - 2)), uvb(wu(0), wv(v - 1)), k))
            mf.add(New meshface(uva(wu(u - 1), wv(v - 2)), k, uvb(wu(u - 2), wv(v - 1))))
          End If

        ElseIf bu Then 'If closed only in the U

          If ((F Or q) And u Mod 2) Then
            mf.add(New meshface(uva(wu(u - 2), wv(v - 1)), uvb(wu(u - 2), wv(0)), uvb(wu(0), wv(0))))
          Else
            mv.add(S.PointAt(0, 0))
            mf.add(New meshface(uva(wu(u - 1), wv(0)), uvb(wu(u - 2), wv(0)), k))
            mf.add(New meshface(uva(wu(0), wv(0)), k, uvb(wu(0), wv(0))))
            k += 1
          End If

          If ((((v + y + 1) Mod 2) Or q) And u Mod 2) Then
            mf.add(New meshface(uva(wu(0), wv(v - 2)), uvb(wu(u - 2), wv(v - 1)), uvb(wu(0), wv(v - 1))))
          Else
            mv.add(S.PointAt(1, 1))
            mf.add(New meshface(uva(wu(u - 1), wv(v - 2)), k, uvb(wu(u - 2), wv(v - 1))))
            mf.add(New meshface(uva(wu(0), wv(v - 2)), uvb(wu(0), wv(v - 1)), k))
            k += 1
          End If

        ElseIf bv Then 'If closed only in the V

          If ((F Or q) And v Mod 2) Then
            mf.add(New meshface(uva(wu(0), wv(0)), uva(wu(0), wv(v - 2)), uvb(wu(0), wv(0))))
          Else
            mv.add(S.PointAt(0, 0))
            mf.add(New meshface(uva(wu(0), wv(v - 2)), uvb(wu(0), wv(v - 1)), k))
            mf.add(New meshface(uva(wu(0), wv(0)), k, uvb(wu(0), wv(0))))
            k += 1
          End If
          If ((((u + y + 1) Mod 2) Or q) And v Mod 2) Then
            mf.add(New meshface(uva(wu(u - 1), wv(0)), uva(wu(u - 1), wv(v - 2)), uvb(wu(u - 2), wv(0))))
          Else
            mv.add(S.PointAt(1, 1))
            mf.add(New meshface(uva(wu(u - 1), wv(v - 2)), k, uvb(wu(u - 2), wv(v - 1))))
            mf.add(New meshface(uva(wu(u - 1), wv(0)), uvb(wu(u - 2), wv(0)), k))
            k += 1
          End If

        Else 'If not closed
          mv.add(S.PointAt(0, 0))
          mv.add(S.PointAt(0, 1))
          mv.add(S.PointAt(1, 1))
          mv.add(S.PointAt(1, 0))
          mf.add(New meshface(uva(wu(0), wv(0)), k, uvb(0, 0)))
          mf.add(New meshface(uva(wu(0), wv(v - 2)), uvb(0, v - 1), k + 1))
          mf.add(New meshface(uva(wu(u - 1), wv(v - 2)), k + 2, uvb(u - 2, v - 1)))
          mf.add(New meshface(uva(wu(u - 1), wv(0)), uvb(u - 2, 0), k + 3))
        End If

      End If

      mo.Vertices.AddVertices(mv.toarray())
      mo.Faces.AddFaces(mf.toarray())
      mo.FaceNormals.ComputeFaceNormals()
      mo.Normals.ComputeNormals()
      
      M = mo
    End If
# ---------- m_snubsqr: VB additional code ----------
  Private Function appendprepend(ByVal i As Integer)
    Dim srsEnum As IEnumerable(Of Integer) = Enumerable.Range(0, i - 1)
    Dim arrVal As New list(Of Integer)
    arrVal = srsEnum.tolist()
    arrVal.add(0)
    Return arrVal
  End Function

  Private Function series(ByVal i As Integer)
    Dim srsEnum As IEnumerable(Of Integer) = Enumerable.Range(0, i)
    Dim arrVal As New list(Of Integer)
    arrVal = srsEnum.tolist()
    Return arrVal
  End Function

  Private Function evalP(ByVal op As point3d, ByVal tp As Point3d, ByVal t As Double)
    Return New point3d(op + (tp - op) * t)
  End Function


  ''' <summary>
  ''' This method will be called once every solution, before any calls to RunScript.
  ''' </summary>
  Public Overrides Sub BeforeRunScript()
  End Sub
  ''' <summary>
  ''' This method will be called once every solution, after any calls to RunScript.
  ''' </summary>
  Public Overrides Sub AfterRunScript()
  End Sub
# ---------- end m_snubsqr ----------
panel = Panel("""0
1""")
number_slider = Slider(0.773, range=0..1)
crv_2 = Curve(<curve referenced from the Rhino model>)
crv_3 = Curve(<curve referenced from the Rhino model>)
tboxmsh = TwistedBoxMesh(Mesh=m_snubsqr.M, Thickness=Slider(0.268, range=0..1), ParametersW=panel)
tboxcents = TwistedBoxCenters(TwistedBox=tboxmsh, CenterType=0)  # -> flatten(Center)
pdecon = Deconstruct(Point=tboxcents)  # -> XComponent, YComponent, ZComponent
reparamnums = ReparameterizeNumbers(Numbers=pdecon.ZComponent, Invert=Toggle(True))  # -> Reparameterized, Original
twn2crvs = TweenTwoCurves(CurveA=crv_3, CurveB=crv_2, Factor=reparamnums.Reparameterized, Refit=0, PointSample=0)
brep = Brep(<brep referenced from the Rhino model>)
box = Box(brep)
reb = RebuildCurve(Curve=twn2crvs, Degree=Slider(1, range=0..1), Count=Slider(25, range=0..100), Tangents=False)
number_slider_2 = Slider(0, range=0..1)
wbtile = WeaverbirdsTile(MeshCurves=graft(reb), FillStrategy=2, OptIn=2)
multiplication = Multiplication(A=Slider(0.108, range=0..1), B=-1)
wbthicken = WeaverbirdsMeshThicken(MeshCurves=wbtile, Distance=multiplication, OffsetType=0)
wbcatmullclark = WeaverbirdsCatmullClarkSubdivision(MeshCurves=wbthicken, Level=Slider(1, range=0..10), SmoothNakedEdges=1)  # -> flatten(OutputMeshCurves)
morph2tbox = MorphToTwistedBox(Geometries=wbcatmullclark, References=box, Targets=tboxmsh)
toggle = BooleanToggle(True)
bmp = Bitmap(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)
swatch = ColourSwatch(SwatchColor=RGB(74, 241, 90))
advancedmaterial = AdvancedMaterial(Color=RGB(255, 255, 255), ColorMap=bmp, Opacity=Slider(0.74, range=0..1), FlatShading=False)
constructattr = ConstructAttributes(Keys="material", Values=graft(advancedmaterial))  # -> flatten(Attributes)
injectattr = InjectAttributes(Attributes=constructattr)
mesh = Mesh(injectattr)
sdinput = ShapeDiverInput(In0=mesh, ParameterSchemas="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")
panel_2 = Panel("Wall to 0,0 transform")
srf = Surface(<surface referenced from the Rhino model>)
srf_2 = Surface(<surface referenced from the Rhino model>)
evalsrf = EvaluateSurface(Surface=reparameterize(srf), Point="0.5, 0.5")  # -> Point, Normal, UDirection, VDirection, Frame
evalsrf_2 = EvaluateSurface(Surface=reparameterize(srf_2), Point="0.5, 0.5")  # -> Point, Normal, UDirection, VDirection, Frame
pln = Plane(evalsrf.Frame)
pln_2 = Plane(evalsrf_2.Frame)
orient = Orient(Source=pln, Target=pln_2)  # -> Geometry, Transform
injectattr_2 = InjectAttributes(Object=orient.Geometry, Attributes=constructattr)
mesh_2 = Mesh(injectattr_2)
update_this_path = Panel("L:\Github\ARjs-Privacy-Screen-Template\assets\screen005.glb")
gltfexport = GlTF20Exporter(Data=mesh_2)
button = Button()
toggle_2 = BooleanToggle(False)
panel_3 = Panel(button)
c_script = CSharpScript(input=gltfexport, path=update_this_path, trigger=button)  # -> out, A; inputs path: String, trigger: Boolean
# ---------- c_script: C# ----------
    if(trigger){
      try {
        System.IO.Stream stream = input as System.IO.Stream;
        using (var fileStream = System.IO.File.Create(path))
        {
          stream.Seek(0, System.IO.SeekOrigin.Begin);
          stream.CopyTo(fileStream);
          A = "File saved successfully.";
        }
      }
      catch(Exception e){
        A = "An error occurred";
        throw e;
      }
    } else {
      A = "Nothing saved. Set the trigger to 'True' to save files.";
    }
# ---------- end c_script ----------
status = Panel(c_script.A)
